# Dynamo graph isovist.dyn (Dynamo 2.16.1.2727)
# author: Bilikova
# Bleblele
# packages: GenerativeDesign 3.0.16.0

# group: boundary area lines
line_A = DSModelElementSelection()  # 1 picked in the model
geometry = Element.Geometry(element=line_A)
remember = Data.Remember(geometry)
line_B = DSModelElementSelection()  # 1 picked in the model
geometry_2 = Element.Geometry(element=line_B)
remember_2 = Data.Remember(geometry_2)
line_C = DSModelElementSelection()  # 1 picked in the model
geometry_3 = Element.Geometry(element=line_C)
remember_3 = Data.Remember(geometry_3)
line_D = DSModelElementSelection()  # 1 picked in the model
geometry_4 = Element.Geometry(element=line_D)
remember_4 = Data.Remember(geometry_4)
join = List.Join(list0=remember, list1=remember_2, list2=remember_3, list3=remember_4)
startPoint = Curve.StartPoint(curve=join)

code_block = CodeBlock(a=startPoint) { a[0]; }
position_X = DoubleSlider(50, range=0..85 step 10)  # graph input
postion_Y = DoubleSlider(60, range=0..85 step 10)  # graph input
translate = Geometry.Translate(geometry=code_block, xTranslation=position_X, yTranslation=postion_Y)
code_block_2 = CodeBlock(point=translate) { point; }
code_block_3 = CodeBlock { 1; }
byCenterPointRadius = Circle.ByCenterPointRadius(centerPoint=translate, radius=code_block_3)
number_circle_division = DoubleSlider(54, range=0..1000 step 1)
pointsAtEqualChordLength = Curve.PointsAtEqualChordLength(curve=byCenterPointRadius, divisions=number_circle_division)
byTwoPoints = Vector.ByTwoPoints(start=translate, end=pointsAtEqualChordLength)

# group: maximum distance at given area
byStartPointEndPoint = Line.ByStartPointEndPoint(startPoint=startPoint, endPoint=code_block_2)
length = Curve.Length(curve=byStartPointEndPoint)
maximumItem = List.MaximumItem(list=length)

byStartPointDirectionLength = Line.ByStartPointDirectionLength(startPoint=code_block_2, direction=byTwoPoints, length=maximumItem)
flatten = List.Flatten(list=byStartPointDirectionLength)
select_model_elements = DSModelElementsSelection()  # 18 picked in the model
geometry_5 = Element.Geometry(element=select_model_elements)
remember_5 = Data.Remember(geometry_5)
list_create = List.Create(item0=join, item1=remember_5)
flatten_2 = List.Flatten(list=list_create)
intersect = Geometry.Intersect(geometry=flatten, other=flatten_2, lacing=CrossProduct)
code_block_4 = CodeBlock { 0; }
clean = List.Clean(list=intersect, preserveIndices=code_block_4)
code_block_5 = CodeBlock { 1; }
flatten_3 = List.Flatten(list=clean@L3, amount=code_block_5)
python_script = Python(IN[0]=flatten_3, IN[1]=maximumItem, IN[2]=code_block_2)  # CPython3
# ---------- python_script.python (61 lines) ----------
# Load the Python Standard and DesignScript Libraries
import sys
import clr
import math
clr.AddReference('ProtoGeometry')
from Autodesk.DesignScript.Geometry import *

# The inputs to this node will be stored as a list in the IN variables.
dataEnteringNode = IN

# Place your code below this line

# Assign your output to the OUT variable.

list = IN[0]
universal_min_distance = IN[1]
center = IN[2]

#data structure
OUT = []
position_center = []
position_point = []
eventList = []

debug = []
i = 0

#assign center point coordinates
position_center.append(center.X)
position_center.append(center.Y)





for sublist in list: 
    #clean variables
    min_distance = universal_min_distance
    min_element = []
    p1 = []
    eventList = []
    
    #debug.append(i)
    for element in sublist: 
        position_point = []
        distance = []
        position_point.append(element.X)
        position_point.append(element.Y)
        distance = math.dist(position_center, position_point)
        #debug.append(element)
        #debug.append(distance)
        if distance < min_distance:
            #debug.append("TRUE")
            min_distance = distance
            min_element = element
    eventList.insert(0, min_element)    
    debug.append(eventList)
    i = i + 1
    
    
OUT = debug
# ----------------------------------------
flatten_4 = List.Flatten(list=python_script)
byPoints = Polygon.ByPoints(points=flatten_4)
byPatch = Surface.ByPatch(closedCurve=byPoints)
area = Surface.Area(surface=byPatch)  # graph output
