# Dynamo graph super_bomba.dyn (Dynamo 2.16.1.2727)
# author: Bilikova_Durrer
# SUPER_BOMBA
# packages: GenerativeDesign 3.0.16.0

categories = Categories("OST_SiteProperty")
all_elements_of_category = ElementsOfCategory(Category=categories)
geometry = Element.Geometry(element=all_elements_of_category)
remember = Data.Remember(geometry)
flatten = List.Flatten(list=remember)
startPoint = Curve.StartPoint(curve=flatten)
code_block = CodeBlock(x=startPoint) { x[2]; }
B1 = DoubleSlider(26, range=0..84 step 1)  # graph input
translate = Geometry.Translate(geometry=code_block, yTranslation=B1)
B3 = DoubleSlider(44, range=0..84 step 1)  # graph input
B4 = DoubleSlider(37, range=0..84 step 1)  # graph input
translate_2 = Geometry.Translate(geometry=code_block, xTranslation=B3, yTranslation=B4)
B2 = DoubleSlider(42, range=0..84 step 1)  # graph input
translate_3 = Geometry.Translate(geometry=code_block, xTranslation=B2)
join = List.Join(list0=code_block, list1=translate, list2=translate_2, list3=translate_3)
code_block_2 = CodeBlock { 1; }
byPoints = PolyCurve.ByPoints(points=join, connectLastToFirst=code_block_2)
b_floor = DoubleSlider(33, range=0..60 step 1)  # graph input
b_kv = CodeBlock { 4; }
code_block_3 = CodeBlock(a=b_floor, kv=b_kv) { 0..#a..kv; }
translate_4 = Geometry.Translate(geometry=byPoints, zTranslation=code_block_3)
byLoft = Surface.ByLoft(crossSections=translate_4)
color_palette = ColorPalette({R: 138, G: 43, B: 226, A: 255})
byGeometryColor = Modifiers.GeometryColor.ByGeometryColor(geometry=byLoft, color=color_palette)
code_block_4 = CodeBlock(x=startPoint) { x[0]; }
A1 = DoubleSlider(12, range=0..84 step 1)  # graph input
code_block_5 = CodeBlock(x=A1) { x*(-1); }
translate_5 = Geometry.Translate(geometry=code_block_4, yTranslation=code_block_5)
A3 = DoubleSlider(26, range=0..84 step 1)  # graph input
code_block_6 = CodeBlock(x=A3) { x*(-1); }
A4 = DoubleSlider(30, range=0..84 step 1)  # graph input
code_block_7 = CodeBlock(x=A4) { x*(-1); }
translate_6 = Geometry.Translate(geometry=code_block_4, xTranslation=code_block_6, yTranslation=code_block_7)
A2 = DoubleSlider(40, range=0..84 step 1)  # graph input
code_block_8 = CodeBlock(x=A2) { x*(-1); }
translate_7 = Geometry.Translate(geometry=code_block_4, xTranslation=code_block_8)
join_2 = List.Join(list0=code_block_4, list1=translate_5, list2=translate_6, list3=translate_7)
code_block_9 = CodeBlock { 1; }
byPoints_2 = PolyCurve.ByPoints(points=join_2, connectLastToFirst=code_block_9)
a_floor = DoubleSlider(19, range=0..60 step 1)  # graph input
a_kv = CodeBlock { 4; }
code_block_10 = CodeBlock(a=a_floor, kv=a_kv) { 0..#a..kv; }
translate_8 = Geometry.Translate(geometry=byPoints_2, zTranslation=code_block_10)
byLoft_2 = Surface.ByLoft(crossSections=translate_8)
color_palette_2 = ColorPalette({R: 255, G: 20, B: 147, A: 255})
byGeometryColor_2 = Modifiers.GeometryColor.ByGeometryColor(geometry=byLoft_2, color=color_palette_2)
byPatch = Surface.ByPatch(closedCurve=byPoints_2)
area = Surface.Area(surface=byPatch)
byPatch_2 = Surface.ByPatch(closedCurve=byPoints)
area_2 = Surface.Area(surface=byPatch_2)
zastavena_plocha = CodeBlock(a=area, b=area_2) { a+b; }
code_block_11 = CodeBlock { 0; }
byJoinedCurves = PolyCurve.ByJoinedCurves(curves=flatten, joinTolerance=code_block_11)
byPatch_3 = Surface.ByPatch(closedCurve=byJoinedCurves)
area_3 = Surface.Area(surface=byPatch_3)
koeficient_zastavenosti = zastavena_plocha / area_3  # graph output
hpp_A = CodeBlock(pocet_podlazi=a_floor, plocha=area) { (pocet_podlazi-1)*plocha; }
hpp_b = CodeBlock(pocet_podlazi=b_floor, plocha=area_2) { (pocet_podlazi-1)*plocha; }
hpp_A_B = hpp_A + hpp_b  # graph output
koeficient_podlaznich_ploch = hpp_A_B / area_3  # graph output
code_block_12 = CodeBlock { a; }  # unwired: a
